# Grasshopper definition Tower-lines.ghx (Grasshopper 1.0.7)

radius = Number(Slider(4, range=0..10))
storiescount = Number(Slider(7, range=0..10))
twist = Number(Slider(7, range=0..10))
height = Number(Slider(65, range=0..110))
offset1 = Number(Slider(7, range=0..10))
offset3 = Number(Slider(6, range=0..10))
offset4 = Number(Slider(5, range=0..10))
offset2 = Number(Slider(6, range=0..10))
Y = UnitY(Factor=1)
Z = UnitZ(Factor=height)
circle = CircleCNR(Center="0,0,0", Normal=Vector(0, 0, 1), Radius=radius)
line = LineSDL(Start="0,0,0", Direction=Y, Length=Z)
divide = DivideCurve(Curve=circle, Count=storiescount, Kinks=False)  # -> Points, Tangents, Parameters
Z_2 = UnitZ(Factor=1)
ln = Line(StartPoint="0,0,0", EndPoint=divide.Points)
divide_2 = DivideCurve(Curve=line, Count=Slider(3, range=0..10), Kinks=False)  # -> Points, Tangents, Parameters
pl = ConstructPlane(Origin=divide.Points, XAxis=ln, YAxis=Z_2)
item = ListItem(List=divide_2.Points, Index=0, Wrap=True)  # -> Item, Item1, Item2, Item3
xy = XYPlane(Origin=Point(0, 0, 0))
X = UnitX(Factor=offset3)
X_2 = UnitX(Factor=offset1)
X_3 = UnitX(Factor=offset4)
X_4 = UnitX(Factor=offset2)
move = Move(Geometry=item.Item3, Motion=X_3)  # -> Geometry, Transform
move_2 = Move(Geometry=item.Item, Motion=X_2)  # -> Geometry, Transform
move_3 = Move(Geometry=item.Item1, Motion=X_4)  # -> Geometry, Transform
move_4 = Move(Geometry=item.Item2, Motion=X)  # -> Geometry, Transform
merge = Merge(Data1=move_2.Geometry, Data2=move_3.Geometry, Data3=move_4.Geometry, Data4=move.Geometry)
intcrv = Interpolate(Vertices=merge, Degree=3, Periodic=False, KnotStyle=1)  # -> Curve, Length, Domain
orient = Orient(Geometry=intcrv.Curve, Source=xy, Target=pl)  # -> Geometry, Transform
cp = ControlPoints(Curve=orient.Geometry)  # -> Points, Weights, Knots
pdecon = Deconstruct(Point=cp.Points)  # -> XComponent, YComponent, ZComponent
bnd = Bounds(Numbers=pdecon.ZComponent)
dom = ConstructDomain(DomainStart=0, DomainEnd=twist)
remap = RemapNumbers(Value=pdecon.ZComponent, Source=bnd, Target=dom)  # -> Mapped, Clipped
rad = Radians(Degrees=remap.Mapped)
rotate = Rotate(Geometry=cp.Points, Angle=rad, Plane=PlaneXY(0, 0, 0))  # -> Geometry, Transform
intcrv_2 = Interpolate(Vertices=rotate.Geometry, Degree=3, Periodic=False, KnotStyle=1)  # -> Curve, Length, Domain
loft = Loft(
    Curves=flatten(intcrv_2.Curve),
    Options={Adjust=False, Closed=True, LoftEnds=0, LoftSimp=0, LoftType=3, Rebuild=10, Refit=0.01})
cap = CapHoles(Brep=loft)
bbox = BoundingBox(Content=cap, Plane=PlaneXY(0, 0, 0))  # -> Box, Box_2
debrep = DeconstructBrep(Brep=bbox.Box)  # -> Faces, Edges, Vertices
debox = DeconstructBox(Box=bbox.Box)  # -> Plane, X, Y, Z
dedomain = DeconstructDomain(Domain=debox.Z)  # -> Start, End
area = Area(Geometry=debrep.Faces)  # -> Area, Centroid
subtraction = Subtraction(A=dedomain.End, B=dedomain.Start)
pdecon_2 = Deconstruct(Point=area.Centroid)  # -> XComponent, YComponent, ZComponent
line_2 = LineSDL(Start="0,0,0", Direction=Vector(0, 0, 1), Length=subtraction)
sort = SortList(Keys=pdecon_2.ZComponent, ValuesA=debrep.Faces)  # -> Keys, ValuesA
item_2 = ListItem(List=sort.ValuesA, Index=0, Wrap=True)
area_2 = Area(Geometry=item_2)  # -> Area, Centroid
divide_3 = DivideCurve(Curve=line_2, Count=10, Kinks=False)  # -> Points, Tangents, Parameters
vec2pt = Vector2Pt(PointA=area_2.Centroid, PointB=divide_3.Points, Unitize=False)  # -> Vector, Length
move_5 = Move(Geometry=item_2, Motion=vec2pt.Vector)  # -> Geometry, Transform
sec = BrepPlane(Brep=cap, Plane=move_5.Geometry)  # -> Curves, Points
boundary = BoundarySurfaces(Edges=sec.Curves)
edges = BrepEdges(Brep=cap)  # -> Naked, Interior, NonManifold
edges_2 = BrepEdges(Brep=boundary)  # -> Naked, Interior, NonManifold
merge_2 = Merge(Data1=flatten(edges.Interior), Data2=flatten(edges_2.Naked))
end = EndPoints(Curve=merge_2)  # -> Start, End
ln_2 = Line(StartPoint=end.Start, EndPoint=end.End)
line_3 = Line(ln_2)
