# Grasshopper definition ex-circles.ghx (Grasshopper 1.0.7)

number = Number()
radius = Number()
cir = Circle(Plane=PlaneXY(0, 0, 0), Radius=radius)
series = Series(Start=0, Step=1, Count=number)
Z = UnitZ(Factor=series)
move = Move(Geometry=cir, Motion=Z)  # -> Geometry, Transform
circle = Circle(move.Geometry)
