# Grasshopper definition ex_tower.ghx (Grasshopper 1.0.7)
# plug-ins: Pufferfish

number_slider = Slider(641, range=0..1000)
xy = XYPlane(Origin=Point(0, 0, 0))
Z = UnitZ(Factor=1)
pt = Point(Point(0, 0, 0))
ellipse = Ellipse(Plane=xy, Radius1=Slider(219.4, range=0..1000), Radius2=Slider(100, range=0..1000))  # -> Ellipse, Focus1, Focus2
line = LineSDL(Start=pt, Direction=Z, Length=number_slider)
division = Division(A=number_slider, B=Slider(18, range=0..100))
divide = DivideCurve(Curve=line, Count=division, Kinks=False)  # -> Points, Tangents, Parameters
lng = ListLength(List=divide.Points)
vec2pt = Vector2Pt(PointA=pt, PointB=divide.Points, Unitize=False)  # -> Vector, Length
subtraction = Subtraction(A=lng, B=1)
move = Move(Geometry=pt, Motion=vec2pt.Vector)  # -> Geometry, Transform
move_2 = Move(Geometry=ellipse.Ellipse, Motion=vec2pt.Vector)  # -> Geometry, Transform
division_2 = Division(A=Slider(45, range=0..100), B=subtraction)
series = Series(Start=0, Step=division_2, Count=lng)
rad = Radians(Degrees=series)
rotate = Rotate(Geometry=move_2.Geometry, Angle=rad, Plane=move.Geometry)  # -> Geometry, Transform
Z_2 = UnitZ(Factor=Slider(0.8, range=0..1))
neg = Negative(Value=Slider(1.5, range=0..10))
rev = Reverse(Vector=Z_2)
offcrv = OffsetCurve(Curve=rotate.Geometry, Distance=neg, Plane=PlaneXY(0, 0, 0), BothSides=False, Kinks=0, CapType=1)  # -> flatten(Offset)
extr = Extrude(Base=rotate.Geometry, Direction=rev)
loft = Loft(Curves=offcrv, Options={Adjust=False, Closed=False, LoftEnds=0, LoftSimp=0, LoftType=0, Rebuild=10, Refit=0.01})
cap = CapHoles(Brep=extr)
mesh = Mesh(cap)
mesh_2 = Mesh(loft)
merge = Merge(Data1=mesh_2, Data2=mesh)  # -> flatten(Result)
mesh_3 = Mesh(merge)
