# Grasshopper definition tower-simple.gh (Grasshopper 1.0.7)

rotation = Number(Slider(5, range=0..10))
stories = Number(Slider(4, range=0..10))
sides = Number(Slider(6, range=0..10))
radius = Number(Slider(6, range=0..10))
height = Number(Slider(65, range=0..110))
division = Division(A=height, B=stories)
rad = Radians(Degrees=rotation)
series = Series(Start=0, Step=division, Count=stories)
polygon = Polygon(Plane=PlaneXY(0, 0, 0), Radius=radius, Segments=sides, FilletRadius=0)  # -> Polygon, Length
Z = UnitZ(Factor=series)
series_2 = Series(Start=0, Step=rad, Count=stories)
move = Move(Geometry=polygon.Polygon, Motion=Z)  # -> Geometry, Transform
Z_2 = UnitZ(Factor=division)
rotate = Rotate(Geometry=move.Geometry, Angle=series_2, Plane=PlaneXY(0, 0, 0))  # -> Geometry, Transform
extr = Extrude(Base=rotate.Geometry, Direction=Z_2)
edges = BrepEdges(Brep=extr)  # -> Naked, Interior, NonManifold
merge = Merge(Data1=flatten(edges.Naked), Data2=flatten(edges.Interior))
end = EndPoints(Curve=merge)  # -> Start, End
ln = Line(StartPoint=end.Start, EndPoint=end.End)
line = Line(ln)
