# Grasshopper definition tower-simple.ghx (Grasshopper 1.0.7)

rotation = Number()
stories = Number()
sides = Number()
radius = Number()
height = Number()
division = Division(A=height, B=stories)
rad = Radians(Degrees=rotation)
series = Series(Start=0, Step=division, Count=stories)
polygon = Polygon(Plane=PlaneXY(0, 0, 0), Radius=radius, Segments=sides, FilletRadius=0)  # -> Polygon, Length
Z = UnitZ(Factor=series)
series_2 = Series(Start=0, Step=rad, Count=stories)
move = Move(Geometry=polygon.Polygon, Motion=Z)  # -> Geometry, Transform
Z_2 = UnitZ(Factor=division)
rotate = Rotate(Geometry=move.Geometry, Angle=series_2, Plane=PlaneXY(0, 0, 0))  # -> Geometry, Transform
extr = Extrude(Base=rotate.Geometry, Direction=Z_2)
edges = BrepEdges(Brep=extr)  # -> Naked, Interior, NonManifold
merge = Merge(Data1=flatten(edges.Naked), Data2=flatten(edges.Interior))
end = EndPoints(Curve=merge)  # -> Start, End
ln = Line(StartPoint=end.Start, EndPoint=end.End)
line = Line(ln)
